# Grasshopper definition konfiguraator.gh (Grasshopper 1.0.7)
# plug-ins: Swiftlet, jSwan, ShapeDiverForGrasshopper, PancakeSpreadsheet

kotzebue_20_tallinn = Panel("101020682")
vs = ValueList({"Muutmata", "SILS 200mm", "Tehaseline paneel õhuke", "Tehaseline paneel paks", "Utoopia"}, selected="Muutmata")
õhuleke = ValueList({"Muutmata", "Tavaline", "Hea", "Väga hea"}, selected="Muutmata")
refresh_kb = Button()
hoone_tüüp = ValueList({"A213", "A214", "B213", "B214", "B224", "C111", "C112", "C113", "C114", "C124", "C211", "C212", "C213", "C214", "C223", "C224"}, selected="B213")
vabriku_36_põlva = Panel("110009871")
akadeemia_tee_62tallinn = Panel("101011007")
kodu = Panel("101031553")
kuklase_6_tallinn = Panel("101010705")
energia_13_tallinn = Panel("101040339")
tartu = Panel("104018667")
kb_path = FilePath("C:\Users\Joosep\PycharmProjects\konfiguraator-app\teadmusbaas\teadmusbaas.xlsx")

# ----
# Viktor.ai väärtus tuleb siin sisse.
# 
# Komponendi nimi peab matchima viktor.ai sisendparameetri nimega (viktor kirjutab kõik sisendparameetrid ja nende väärtused json-i)
ehr = GetInteger("101020350", AtLeast=1, AtMost=1, Maximum=2147483647, Minimum=-2147483648, TreeAccess=False)
vs_2 = GetString(vs, AtLeast=1, AtMost=1, TreeAccess=False)
ohuleke = GetString(õhuleke, AtLeast=1, AtMost=1, TreeAccess=False)

# ---- group: õhuleke
psconcellrange = ConstructCellRange(StartingCell="A1", EndingCell="B10")
pssimpleread = SimpleReadXLSX(File=kb_path, SheetIdentifier="õhuleke", RowFirst=True, OK=Toggle(True))
lng = ListLength(List=pssimpleread)  # -> flatten(Length)
split = SplitList(List=lng, Index="1")  # -> ListA, ListB
python = GhPythonScript(data=flatten(pssimpleread), len=split.ListA)  # -> out, a; inputs data: list
# ---------- python: Python ----------
__author__ = "Joosep"
__version__ = "2024.02.12"

import rhinoscriptsyntax as rs

a = ""

keys = data[0:len]
for i, line in enumerate(data[len:]):
    if i%len == 0:  # rea esimene
        a += "\n{"
        
    a += '"' + keys[i%len] + '": '
    
    if keys[i%len] == 'Nimetus':
        a += '"' + str(line) + '"'
    elif keys[i%len] == 'Välisviimistlus':
        a += '"' + str(line) + '"'
    elif keys[i%len] == 'Lühikirjeldus':
        a += '"' + str(line) + '"'
    elif str(line) in ['None', '', '-']:
        a += '""'
    else: a += str(line)

    if i%len <= len-2:
        a += ", "
    if i%len == len-1:  # rea viimane
        a += "},"

a = "[" + a + "\n]"
a = a.replace("},\n]", "}\n]")

print(a)
# ---------- end python ----------
python_2 = GhPythonScript(data=python.a, nimetusValue=ohuleke)  # -> out, a, keys, values
#   port keys: The list of keys from the matching dictionary
#   port values: The list of values from the matching dictionary
# ---------- python_2: Python ----------
"""Provides a scripting component.
    Inputs:
        data: The JSON array as a JArray object
        nimetusValue: The specific "nimetus" value you're looking for (e.g., "VS1 - ol.ol")
    Output:
        a: The a output variable (JSON string of the matching dictionary or message)"""

__author__ = "Joosep"
__version__ = "2024.02.03"

import json

#Parse the JSON string into a Python object (list of dictionaries)
data_list = json.loads(data)

# Initialize outputs
keys = []
values = []

# Search for the dictionary with the matching 'nimetusValue'
for item in data_list:
    if item.get("Nimetus") == nimetusValue:
        # If a match is found, extract the keys and values
        keys = item.keys()
        values = item.values()
        break  # Exit the loop after finding the first match

# Convert the keys and values to lists, if they aren't already
keys = list(keys)
values = list(values)

# Now, 'keys' and 'values' are ready for output
# ---------- end python_2 ----------
pjs = ParseJSONString(Text=python.a)
python_3 = GhPythonScript(valuelist="õhuleke", inputjson=pjs)
# ---------- python_3: Python ----------
"""Provides a scripting component.
    Inputs:
        valuelist: the valuelist to update
        inputjson: the content of the valuelist
    Output:
        None"""

__author__ = "Joosep"
__version__ = "2024.02.03"

import rhinoscriptsyntax as rs
import Grasshopper as gh

names = []

for item in inputjson:
    names.append(item["Nimetus"].ToString())


def updateValueList(nickname, names):
    # Get the active Grasshopper document
    doc = ghenv.Component.OnPingDocument()

    # Find all components that match the nickname
    components = [obj for obj in doc.Objects if type(obj) == gh.Kernel.Special.GH_ValueList and obj.NickName == nickname]
    
    # If a matching component is found, update it
    if components:
        valueList = components[0]
        valueList.ListItems.Clear()
        
        for name in names:
            print(name)
            item = gh.Kernel.Special.GH_ValueListItem(name, "\"" + name + "\"")
            valueList.ListItems.Add(item)
            
        # Update the component to reflect changes
        valueList.ExpireSolution(True)

# 'names' should be the list of strings you want to populate the Value List with
# names = ["Option 1", "Option 2", "Option 3"]  # Replace with your actual data
updateValueList(valuelist, names)
# ---------- end python_3 ----------
panel = Panel(python_2.keys)
panel_2 = Panel(python_2.values)
mindex = MemberIndex(Set=python_2.keys, Member="Nimetus")  # -> Index, Count
mindex_2 = MemberIndex(Set=python_2.keys, Member="Õhulekkearv")  # -> Index, Count
item = ListItem(List=python_2.values, Index=mindex.Index, Wrap=True)
item_2 = ListItem(List=python_2.values, Index=mindex_2.Index, Wrap=True)

# ---- group: EHR-i andmete sissetoomine
cqp = CreateQueryParam(Key="ehr_code", Value=ehr)
get = GETRequest(URL="https://livekluster.ehr.ee/api/building/v2/buildingData", Params=cqp)  # -> Status, Content, Response
pjs_2 = ParseJSONString(Text=get.Content)
rjo = ReadJSONObject(JObject=pjs_2)  # -> Keys, JTokens
rjo_2 = ReadJSONObject(JObject=rjo.JTokens)  # -> Keys, JTokens

# ----
dejson = DeserializeJson(JSON=get.Content, OutputsLocked=False)
dejson_2 = DeserializeJson(JSON=dejson, OutputsLocked=False)  # -> EhitiseKujud, EhitiseAndmed, EhitiseKehand, EhitiseAadressid, EhitisePohiandmed, EhitiseEnergiamargised, EhitiseKatastriyksused, EhitiseKasutusotstarbed, EhitiseEnergiamargisedV3, EhitiseTehnilisedNaitajad
dejson_3 = DeserializeJson(JSON=dejson_2.EhitiseAadressid, OutputsLocked=False)
dejson_4 = DeserializeJson(JSON=dejson_2.EhitiseKatastriyksused, OutputsLocked=False)
dejson_5 = DeserializeJson(JSON=dejson_3, OutputsLocked=False)  # -> Oper, AdrId, Olekviit, Koodaadress, Lahiaadress, Taisaadress, AadressTekstina
dejson_6 = DeserializeJson(JSON=dejson_4, OutputsLocked=False)  # -> Id, Olek, Oper, Adob_id, Ads_oid, Kayk_id, KontrKp, Lahiaadress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
panel_3 = Panel(dejson_6.Id)
dejson_7 = DeserializeJson(JSON=dejson_2.EhitiseKehand, OutputsLocked=False)
dejson_8 = DeserializeJson(JSON=dejson_7, OutputsLocked=False)  # -> Tekkeviis, KehandOper, EhitiseOsad, Hoone_kuju_id, KehandUpdated, Esmane_kasutus, Do_ehitis_kehand_id
dejson_9 = DeserializeJson(JSON=dejson_8.EhitiseOsad, OutputsLocked=False)
dejson_10 = DeserializeJson(JSON=dejson_9, OutputsLocked=False)  # -> Id, Liik, Tahis, AdsOid, Aadress, Adob_id, EhrKood, LiikTxt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
panel_4 = Panel(dejson_10.Markused)
dejson_11 = DeserializeJson(JSON=dejson_2.EhitiseEnergiamargisedV3, OutputsLocked=False)

# ---- group: Hooneosade andmed / Hoone osad
mindex_3 = MemberIndex(Set=rjo_2.Keys, Member="ehitiseKehand")  # -> Index, Count
item_3 = ListItem(List=rjo_2.JTokens, Index=mindex_3.Index, Wrap=True)
rjo_3 = ReadJSONObject(JObject=item_3)  # -> Keys, JTokens
rja = ReadJSONArray(Array=rjo_3.JTokens)
rjo_4 = ReadJSONObject(JObject=rja)  # -> Keys, JTokens
mindex_4 = MemberIndex(Set=rjo_4.Keys, Member="ehitiseOsad")  # -> Index, Count
item_4 = ListItem(List=rjo_4.JTokens, Index=mindex_4.Index, Wrap=True)
rjo_5 = ReadJSONObject(JObject=item_4)  # -> Keys, JTokens
rja_2 = ReadJSONArray(Array=rjo_5.JTokens)
rjo_6 = ReadJSONObject(JObject=rja_2)  # -> Keys, JTokens

# ----
dejson_12 = DeserializeJson(JSON=dejson_11, OutputsLocked=False)  # -> DokNr, DotyId, OsaKood, EtaKekVal, OnOsaline, DokNimetus, DokSeisund, EnMargisId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

# ---- group: Tehnosüsteemide andmed
mindex_5 = MemberIndex(Set=rjo_2.Keys, Member="ehitiseTehnilisedNaitajad")  # -> Index, Count
item_5 = ListItem(List=rjo_2.JTokens, Index=mindex_5.Index, Wrap=True)
rjo_7 = ReadJSONObject(JObject=item_5)  # -> Keys, JTokens
rja_3 = ReadJSONArray(Array=rjo_7.JTokens)
rjo_8 = ReadJSONObject(JObject=rja_3)  # -> simplify(Keys), simplify(JTokens)
mindex_6 = MemberIndex(Set=rjo_8.Keys, Member="klNimetus")  # -> Index, Count
mindex_7 = MemberIndex(Set=rjo_8.Keys, Member="nimetus")  # -> Index, Count
item_6 = ListItem(List=rjo_8.JTokens, Index=mindex_6.Index, Wrap=True)
panel_5 = Panel(item_6)
item_7 = ListItem(List=rjo_8.JTokens, Index=mindex_7.Index, Wrap=True)
rjv = ReadJSONValue(JValue=item_6)  # -> flatten(AsString), AsNumber, AsBool
rjv_2 = ReadJSONValue(JValue=item_7)  # -> flatten(AsString), AsNumber, AsBool

# ---- group: Hooneosade andmed
panel_6 = Panel(rjo_4.Keys)

# ----
dejson_13 = DeserializeJson(JSON=dejson_2.EhitisePohiandmed, OutputsLocked=False)  # -> Korgus, Maakond, Kinavald, EhAlustKp, MahtBruto, Oletuslik, TubadeArv, OmandiLiik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

# ---- group: Hooneosade andmed
mindex_8 = MemberIndex(Set=rjo_6.Keys, Member="ehitiseOsaPohiandmed")  # -> Index, Count
item_8 = ListItem(List=rjo_6.JTokens, Index=mindex_8.Index, Wrap=True)
rjv_3 = ReadJSONValue(JValue=item_8)  # -> simplify(AsString), AsNumber, AsBool
split_2 = TextSplit(Text=rjv_3.AsString, Separators=",")
rep = ReplaceText(Text=split_2, Find="{", RecursiveReplace=False)
rep_2 = ReplaceText(Text=rep, Find="}", RecursiveReplace=False)
trim = TextTrim(Text=rep_2, Start=True, End=True)
rep_3 = ReplaceText(Text=trim, Find="\"", RecursiveReplace=False)
split_3 = TextSplit(Text=rep_3, Separators=": ")
cull_i = CullIndex(List=split_3, Indices="1", Wrap=True)
trim_2 = TrimTree(Tree=cull_i, Depth=1)
item_9 = ListItem(List=trim_2, Index="1", Wrap=True)
item_10 = ListItem(List=trim_2, Index="0", Wrap=True)
trim_3 = TrimTree(Tree=item_10, Depth=1)
trim_4 = TrimTree(Tree=item_9, Depth=1)

# ----
dejson_14 = DeserializeJson(JSON=dejson_2.EhitiseKujud, OutputsLocked=False)
dejsonkv = DeserializeKeysAndValues(JSON=dejson_14, Keys="geometry")  # -> Key, Value
dejsonkv_2 = DeserializeKeysAndValues(JSON=dejson_14, Keys="viitepunktX")  # -> Key, Value
dejsonkv_3 = DeserializeKeysAndValues(JSON=dejson_14, Keys="viitepunktY")  # -> Key, Value
dejsonkv_4 = DeserializeKeysAndValues(JSON=dejson_14, Keys="ehitiseKujuAadressid")  # -> Key, Value
dejson_15 = DeserializeJson(JSON=dejsonkv_4.Value, OutputsLocked=False)
dejsonkv_5 = DeserializeKeysAndValues(JSON=dejson_15, Keys="tase1_nimetus")  # -> Key, Value
dejsonkv_6 = DeserializeKeysAndValues(JSON=dejson_15, Keys="tase2_nimetus")  # -> Key, Value

# ---- group: Hooneosade andmed / Akendega ruumide arv
mindex_9 = MemberIndex(Set=trim_3, Member="tualettruumide_arv")  # -> Index, Count
mindex_10 = MemberIndex(Set=trim_3, Member="tubadeArv")  # -> Index, Count
mindex_11 = MemberIndex(Set=trim_3, Member="kook")  # -> Index, Count
mindex_12 = MemberIndex(Set=trim_3, Member="kooginish")  # -> Index, Count
item_11 = ListItem(List=trim_4, Index=mindex_9.Index, Wrap=True)
item_12 = ListItem(List=trim_4, Index=mindex_10.Index, Wrap=True)
item_13 = ListItem(List=trim_4, Index=mindex_11.Index, Wrap=True)
item_14 = ListItem(List=trim_4, Index=mindex_12.Index, Wrap=True)
addition = Addition(A=item_14, B=0)
trim_5 = TrimTree(Tree=item_13, Depth=1)
trim_6 = TrimTree(Tree=item_11, Depth=1)
trim_7 = TrimTree(Tree=item_12, Depth=1)
trim_8 = TrimTree(Tree=addition, Depth="2")
addition_2 = Addition(A=trim_7, B=trim_5)
addition_3 = Addition(A=addition_2, B=trim_8)
addition_4 = Addition(A=addition_3, B=trim_6)
ma = MassAddition(Input=addition_4)  # -> Result, PartialResults
ma_2 = MassAddition(Input=addition_3)  # -> Result, PartialResults

# ---- group: Hooneosade andmed / Eluruumide ja mitteeluruumiide pindala
mindex_13 = MemberIndex(Set=trim_3, Member="pind")  # -> Index, Count
item_15 = ListItem(List=trim_4, Index=mindex_13.Index, Wrap=True)
trim_9 = TrimTree(Tree=item_15, Depth=1)
ma_3 = MassAddition(Input=trim_9)  # -> Result, PartialResults
nullrep = ReplaceNulls(Items=ma_3.Result, Replacements="0")  # -> Items, Count

# ---- group: Tehnosüsteemide andmed / Tehnosüsteemid
mindex_14 = MemberIndex(Set=rjv.AsString, Member="Soojusallikas")  # -> Index, Count
mindex_15 = MemberIndex(Set=rjv.AsString, Member="Soojusvarustuse liik")  # -> Index, Count
mindex_16 = MemberIndex(Set=rjv.AsString, Member="Võrgu- või mahutigaasi olemasolu")  # -> Index, Count
mindex_17 = MemberIndex(Set=rjv.AsString, Member="Energiaallikas")  # -> Index, Count
mindex_18 = MemberIndex(Set=rjv.AsString, Member="Ventilatsiooni liik")  # -> Index, Count
mindex_19 = MemberIndex(Set=rjv.AsString, Member="Elektrisüsteemi liik")  # -> Index, Count
mindex_20 = MemberIndex(Set=rjv.AsString, Member="Veevarustuse liik")  # -> Index, Count
mindex_21 = MemberIndex(Set=rjv.AsString, Member="Kanalisatsiooni liik")  # -> Index, Count
mindex_22 = MemberIndex(Set=rjv.AsString, Member="Jahutussüsteemi liik")  # -> Index, Count
item_16 = ListItem(List=rjv_2.AsString, Index=mindex_14.Index, Wrap=True)  # -> flatten(Item)
item_17 = ListItem(List=rjv_2.AsString, Index=mindex_15.Index, Wrap=True)  # -> flatten(Item)
item_18 = ListItem(List=rjv_2.AsString, Index=mindex_16.Index, Wrap=True)  # -> flatten(Item)
item_19 = ListItem(List=rjv_2.AsString, Index=mindex_17.Index, Wrap=True)  # -> flatten(Item)
item_20 = ListItem(List=rjv_2.AsString, Index=mindex_18.Index, Wrap=True)  # -> flatten(Item)
item_21 = ListItem(List=rjv_2.AsString, Index=mindex_19.Index, Wrap=True)  # -> flatten(Item)
item_22 = ListItem(List=rjv_2.AsString, Index=mindex_20.Index, Wrap=True)  # -> flatten(Item)
item_23 = ListItem(List=rjv_2.AsString, Index=mindex_21.Index, Wrap=True)  # -> flatten(Item)
item_24 = ListItem(List=rjv_2.AsString, Index=mindex_22.Index, Wrap=True)  # -> flatten(Item)

# ---- group: Hooneosade andmed / Hooneosa liik
mindex_23 = MemberIndex(Set=rjo_6.Keys, Member="liikTxt")  # -> Index, Count
item_25 = ListItem(List=rjo_6.JTokens, Index=mindex_23.Index, Wrap=True)
rjv_4 = ReadJSONValue(JValue=item_25)  # -> AsString, AsNumber, AsBool
suirify = Suirify(rjv_4.AsString)

# ---- group: Hooneosade andmed / Hooneosade nr
mindex_24 = MemberIndex(Set=rjo_6.Keys, Member="tahis")  # -> Index, Count
item_26 = ListItem(List=rjo_6.JTokens, Index=mindex_24.Index, Wrap=True)
rjv_5 = ReadJSONValue(JValue=item_26)  # -> simplify(AsString), AsNumber, AsBool

# ----
dejson_16 = DeserializeJson(JSON=dejson_2.EhitiseKasutusotstarbed, OutputsLocked=False)
dejson_17 = DeserializeJson(JSON=dejson_2.EhitiseEnergiamargised, OutputsLocked=False)

# ---- group: Tehnosüsteemide andmed / Konstruktsioonid
mindex_25 = MemberIndex(Set=rjv.AsString, Member="Välisseina liik")  # -> Index, Count
mindex_26 = MemberIndex(Set=rjv.AsString, Member="Kande- ja jäigastavate konstruktsioonide materjal")  # -> Index, Count
mindex_27 = MemberIndex(Set=rjv.AsString, Member="Välisseina välisviimistluse materjal")  # -> Index, Count
mindex_28 = MemberIndex(Set=rjv.AsString, Member="Katusekatte materjal")  # -> Index, Count
mindex_29 = MemberIndex(Set=rjv.AsString, Member="Katuste ja katuselagede kandva osa materjal")  # -> Index, Count
mindex_30 = MemberIndex(Set=rjv.AsString, Member="Vundamendi liik")  # -> Index, Count
mindex_31 = MemberIndex(Set=rjv.AsString, Member="Vahelagede kandva osa materjal")  # -> Index, Count
item_27 = ListItem(List=rjv_2.AsString, Index=mindex_26.Index, Wrap=True)  # -> flatten(Item)
item_28 = ListItem(List=rjv_2.AsString, Index=mindex_27.Index, Wrap=True)  # -> flatten(Item)
item_29 = ListItem(List=rjv_2.AsString, Index=mindex_28.Index, Wrap=True)  # -> flatten(Item)
item_30 = ListItem(List=rjv_2.AsString, Index=mindex_29.Index, Wrap=True)  # -> flatten(Item)
item_31 = ListItem(List=rjv_2.AsString, Index=mindex_30.Index, Wrap=True)  # -> flatten(Item)
item_32 = ListItem(List=rjv_2.AsString, Index=mindex_31.Index, Wrap=True)  # -> flatten(Item)
item_33 = ListItem(List=rjv_2.AsString, Index=mindex_25.Index, Wrap=True)  # -> flatten(Item)

# ----
dejson_18 = DeserializeJson(JSON=dejson_16, OutputsLocked=False)  # -> Oper, KaosId, Ehos_id, KaosKood, KaosIdTxt, EluruumidePind, MitteeluruumidePind
dejson_19 = DeserializeJson(JSON=dejson_17, OutputsLocked=False)  # -> AadrId, Dok_nr, DokLiik, Seisund, EtaKekVal, HooneLiik, RekoAasta, EhEhitisId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
dejson_20 = DeserializeJson(JSON=dejson_2.EhitiseAndmed, OutputsLocked=False)  # -> Url, Oper, AdsOid, EhitId, EhrKood, Nimetus, Seisund, KaosKood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
panel_7 = Panel(dejson_19.KoetavPind)

# ---- group: Digikaksiku LOD2 sissetoomine
bbox = GhPythonScript(x=dejsonkv.Value)  # -> a, b, c
# ---------- bbox: Python ----------
"""Provides a scripting component.
    Inputs:
        x: The x script variable
    Output:
        a: The a output variable
        b: The b output variable"""

__author__ = "Joosep"
__version__ = "2024.02.01"

import rhinoscriptsyntax as rs
import json

input_data = json.loads(str(x))

# Extract all coordinates from the input data
all_coords = input_data["coordinates"][0]

# Find the smallest and largest values for x and y coordinates
min_x = min(coord[0] for coord in all_coords) +1
max_x = max(coord[0] for coord in all_coords) -1
min_y = min(coord[1] for coord in all_coords) +1
max_y = max(coord[1] for coord in all_coords) -1
avg_x = (min_x+max_x)/2
avg_y = (min_y+max_y)/2

# return format bbox=6588262.1,541752.46,6588340,541853.3

a = "{},{},{},{}".format(avg_x, avg_y, avg_x + 1, avg_y + 1)
b = "{},{},{},{}".format(min_x, min_y, max_x, max_y)
c = "{},{},{},{}".format(min_x-250, min_y-250, max_x+250, max_y+250)
# ---------- end bbox ----------
concat = Concatenate(
    FragmentA="https://devkluster.ehr.ee/api/3dtwin/v1/rest-api/particles",
    FragmentB="?",
    FragmentC="bbox",
    FragmentD="=",
    FragmentE=bbox.a)
panel_8 = Panel(concat)
gzip = GhPythonScript(url=concat)  # -> out, particles
# ---------- gzip: Python ----------
"""Provides a scripting component.
    Inputs:
        url: The x script variable
    Output:
        particles: The a output variable"""

__author__ = "Joosep"
__version__ = "2024.02.01"

import rhinoscriptsyntax as rs

import urllib2
import clr
import json

# Add references to the .NET assemblies that contain the types we need
clr.AddReference('System')
clr.AddReference('System.IO')
clr.AddReference('System.IO.Compression')

from System.IO import MemoryStream, StreamReader, SeekOrigin
from System.IO.Compression import GZipStream, CompressionMode
from System import Array, Byte

# Set headers to mimic a real browser request
headers = { 'User-Agent': 'Mozilla/5.0' }
request = urllib2.Request(url, headers=headers)

try:
    response = urllib2.urlopen(request)
    
    # Check if the content is GZip encoded
    if response.info().get('Content-Encoding') == 'gzip':
        compressed_data = response.read()

        # Convert compressed_data to a byte array
        data_bytes = Array[Byte](list(bytearray(compressed_data)))

        # Prepare a stream from the compressed data
        compressed_stream = MemoryStream()
        compressed_stream.Write(data_bytes, 0, data_bytes.Length)
        compressed_stream.Seek(0, SeekOrigin.Begin)  # Go to the start of the stream

        # Decompress the data
        with GZipStream(compressed_stream, CompressionMode.Decompress) as decompressed_stream:
            reader = StreamReader(decompressed_stream)
            uncompressed_data = reader.ReadToEnd()

        particles = uncompressed_data
        # particles = json.loads(uncompressed_data)[0]['particles']
    else:
        # If the content is not GZip, simply read it as plain text
        uncompressed_data = response.read()
        particles = uncompressed_data

except urllib2.HTTPError as e:
    print("HTTPError: ", str(e.code) + " " + e.reason)
except urllib2.URLError as e:
    print("URLError: ", e.reason)
# ---------- end gzip ----------
dejson_21 = DeserializeJson(JSON=gzip.particles, OutputsLocked=False)
dejson_22 = DeserializeJson(JSON=dejson_21, OutputsLocked=False)  # -> Etak, Ehr, Particles

# ----
panel_9 = Panel(bbox.c)
gzip_2 = GhPythonScript(url=concat)  # -> out, particles; disabled
# ---------- gzip_2: Python ----------
"""Provides a scripting component.
    Inputs:
        url: The x script variable
    Output:
        particles: The a output variable"""

__author__ = "Joosep"
__version__ = "2024.02.01"

import rhinoscriptsyntax as rs

import urllib2
import clr
import json

# Add references to the .NET assemblies that contain the types we need
clr.AddReference('System')
clr.AddReference('System.IO')
clr.AddReference('System.IO.Compression')

from System.IO import MemoryStream, StreamReader, SeekOrigin
from System.IO.Compression import GZipStream, CompressionMode
from System import Array, Byte

try:
    response = urllib2.urlopen(url)
except urllib2.HTTPError as e:
    print("HTTPError: ", str(e.code) + " " + e.reason)
except urllib2.URLError as e:
    print("URLError: ", e.reason)

compressed_data = response.read()

# Convert compressed_data to a byte array
data_bytes = Array[Byte](list(bytearray(compressed_data)))

# Prepare a stream from the compressed data
compressed_stream = MemoryStream()
compressed_stream.Write(data_bytes, 0, data_bytes.Length)
compressed_stream.Seek(0, SeekOrigin.Begin)  # Go to the start of the stream

# Decompress the data
with GZipStream(compressed_stream, CompressionMode.Decompress) as decompressed_stream:
    reader = StreamReader(decompressed_stream)
    uncompressed_data = reader.ReadToEnd()

particles = uncompressed_data
#particles = json.loads(uncompressed_data)[0]['particles']
# ---------- end gzip_2 ----------

# ---- group: Suhtelise nulli vektor / Suhtelise nulli XY vektor
pt = ConstructPoint(XCoordinate=dejsonkv_2.Value, YCoordinate=dejsonkv_3.Value, ZCoordinate=0)
multiplication = Multiplication(A=pt, B="-1")

# ---- group: Hoone kujujoon
dejson_23 = DeserializeJson(JSON=dejsonkv.Value, OutputsLocked=False)  # -> Type, flatten(Coordinates)
dejson_24 = DeserializeJson(JSON=dejson_23.Coordinates, OutputsLocked=False)  # -> flatten(Array)
dejson_25 = DeserializeJson(JSON=dejson_24, OutputsLocked=False)
convertjson = ConvertJSON(Object=dejson_25)  # -> flatten(Converted)
pt_2 = Point(convertjson)
move = Move(Geometry=pt_2, Motion=multiplication)  # -> flatten(Geometry), Transform
pline = PolyLine(Vertices=move.Geometry, Closed=False)

# ---- group: Soft Academy korterelamute filter
# Akadeemia tee 22
# Akadeemia tee 14
# Akadeemia tee 6
# Akadeemia tee 4
panel_10 = Panel("""101019975
101019954
101016637
101020350""")

# ----
# Tüüpgeomeetria on prototüüpi raames 	internalized, kuna parameetrilisus pole hetkel oluline ja on selle parameetriline arvutus on arvestatav ressursikulu
# 
# Vt Ergo Pikase 1-464 tüübi mall
# \OneDrive - Tallinna Tehnikaülikool\Mustamäe Akadeemia konfiguraator ja andmed
data = Data(Tree({0;0}: [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], {0;1}: [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], {0;2}: [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], {0;3}: [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], {0;4}: [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], {1;0}: [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]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))

# ---- group: Move and rotate to location
rad = Radians(Degrees=Slider(91, range=0..360))
vec = VectorXYZ(XComponent=Slider(0, range=0..100), YComponent=Slider(0, range=0..100), ZComponent=0)  # -> Vector, Length
rot3d = Rotate3D(Geometry=data, Angle=rad, Center=Point(0, 0, 0), Axis=Vector(0, 0, 1))  # -> Geometry, Transform
move_2 = Move(Geometry=rot3d.Geometry, Motion=vec.Vector)  # -> Geometry, Transform

# ---- group: 1-464 korterelamute filter
# Akadeemia tee 22
# Akadeemia tee 14
# Akadeemia tee 6
# Akadeemia tee 4
# Akadeemia tee 62
panel_11 = Panel("""101019975
101019954
101016637
101020350
101011007""")

# ---- group: Soft Academy korterelamute filter
equals = Equality(FirstNumber=panel_11, SecondNumber=dejson_20.EhrKood)  # -> Equality, Inequality
ma_4 = MassAddition(Input=equals.Equality)  # -> Result, PartialResults
bool = Boolean(ma_4.Result)

# ---- group: Component finder
c_script = CSharpScript(x="400d9280-a7ae-4b09-92fe-6b9aa3e6acc9")  # -> out, A
# ---------- c_script: C# ----------
    // Assuming 'x' is your input object, convert 'x' to a string
    string guidString = x as string;

    if (string.IsNullOrEmpty(guidString))
    {
      A = "No GUID provided.";
      return;
    }

    Guid guid;
    if (!Guid.TryParse(guidString, out guid))
    {
      A = "Invalid GUID format.";
      return;
    }

    bool found = false;
    foreach (var obj in GrasshopperDocument.Objects)
    {
      if (obj.InstanceGuid == guid)
      {
        obj.Attributes.Selected = true;
        A = "Component found and selected. Please manually locate it on the canvas.";
        found = true;
        break;
      }
    }

    if (!found)
    {
      A = "Component not found.";
    }
# ---------- end c_script ----------
panel_12 = Panel(c_script.A)

# ---- group: 1-464 korterelamute filter
equals_2 = Equality(FirstNumber=panel_11, SecondNumber=dejson_20.EhrKood)  # -> Equality, Inequality
ma_5 = MassAddition(Input=equals_2.Equality)  # -> Result, PartialResults
bool_2 = Boolean(ma_5.Result)

# ----
ungroup = Ungroup(Group=move_2.Geometry)  # -> simplify(Objects)
filter = StreamFilter(Gate=bool_2, Stream1=ungroup)
panel_13 = Panel(filter)

# ---- group: ExternalWallSurfacesWithoutOpenings
split_4 = SplitTree(Data=filter, Masks=flatten(["{3;*}", "{4;*}"]))  # -> simplify(Positive), Negative
mjoin = MeshJoin(Meshes=flatten(split_4.Positive))
mcol = MeshColours(Mesh=mjoin, Colours=ColourSwatch(SwatchColor=RGB(99, 99, 40)))

# ---- group: InternalWallsAndCeilings
split_5 = SplitTree(Data=filter, Masks=flatten(["{5;*}", "{6;*}", "{7;*}", "{8;*}", "{9;*}"]))  # -> simplify(Positive), Negative
mjoin_2 = MeshJoin(Meshes=flatten(split_5.Positive))
mcol_2 = MeshColours(Mesh=mjoin_2, Colours=ColourSwatch(SwatchColor=RGB(153, 153, 153)))

# ---- group: Windows
split_6 = SplitTree(Data=filter, Masks=flatten(["{18;*}", "{19;*}", "{20;*}", "{21;*}"]))  # -> simplify(Positive), Negative
mjoin_3 = MeshJoin(Meshes=flatten(split_6.Positive))
mcol_3 = MeshColours(Mesh=mjoin_3, Colours=ColourSwatch(SwatchColor=RGB(103, 150, 161)))

# ---- group: ExternalDoors
split_7 = SplitTree(Data=filter, Masks=flatten("{22;*}"))  # -> simplify(Positive), Negative
mjoin_4 = MeshJoin(Meshes=flatten(split_7.Positive))
mcol_4 = MeshColours(Mesh=mjoin_4, Colours=ColourSwatch(SwatchColor=RGB(105, 0, 0)))

# ---- group: BalconyFloors
split_8 = SplitTree(Data=filter, Masks=flatten("{23;*}"))  # -> simplify(Positive), Negative
mjoin_5 = MeshJoin(Meshes=flatten(split_8.Positive))
mcol_5 = MeshColours(Mesh=mjoin_5, Colours=ColourSwatch(SwatchColor=RGB(89, 62, 42)))

# ---- group: BalconyRailings
split_9 = SplitTree(Data=filter, Masks=flatten("{24;*}"))  # -> simplify(Positive), Negative
mjoin_6 = MeshJoin(Meshes=flatten(split_9.Positive))
mcol_6 = MeshColours(Mesh=mjoin_6, Colours=ColourSwatch(SwatchColor=RGB(34, 37, 61)))

# ---- group: RoofSurfacesAndVolume
panel_14 = Panel("{12;*}")
split_10 = SplitTree(Data=filter, Masks=flatten("{11;*}"))  # -> simplify(Positive), Negative
mjoin_7 = MeshJoin(Meshes=flatten(split_10.Positive))
mcol_7 = MeshColours(Mesh=mjoin_7, Colours=ColourSwatch(SwatchColor=RGB(153, 153, 153)))

# ----
context_bake = ContextBake(ExternalWallSurfacesWithoutOpenings=mcol)
context_bake_2 = ContextBake(InternalWallsAndCeilings=mcol_2)
context_bake_3 = ContextBake(RoofSurfacesAndVolume=mcol_7)
context_bake_4 = ContextBake(BalconyRailings=mcol_6)
context_bake_5 = ContextBake(ExternalDoors=mcol_4)
context_bake_6 = ContextBake(BalconyFloors=mcol_5)
context_bake_7 = ContextBake(Geometry=mcol_3)
panel_15 = Panel(mcol_7)
pssimpleread_2 = SimpleReadXLSX(File=kb_path, SheetIdentifier="vs", RowFirst=True, OK=Toggle(True))

lng_2 = ListLength(List=pssimpleread_2)  # -> flatten(Length)
split_11 = SplitList(List=lng_2, Index="1")  # -> ListA, ListB
python_4 = GhPythonScript(data=flatten(pssimpleread_2), len=split_11.ListA)  # -> out, a; inputs data: list; same code as python
python_5 = GhPythonScript(data=python_4.a, nimetusValue=vs_2)  # -> out, a, keys, values; same code as python_2
pjs_3 = ParseJSONString(Text=python_4.a)
python_6 = GhPythonScript(valuelist="vs", inputjson=pjs_3)  # same code as python_3
panel_16 = Panel(python_5.keys)
panel_17 = Panel(python_5.values)
mindex_32 = MemberIndex(Set=python_5.keys, Member="Nimetus")  # -> Index, Count
mindex_33 = MemberIndex(Set=python_5.keys, Member="Paksus")  # -> Index, Count
mindex_34 = MemberIndex(Set=python_5.keys, Member="U-arv")  # -> Index, Count
item_34 = ListItem(List=python_5.values, Index=mindex_32.Index, Wrap=True)
item_35 = ListItem(List=python_5.values, Index=mindex_33.Index, Wrap=True)
item_36 = ListItem(List=python_5.values, Index=mindex_34.Index, Wrap=True)
multiplication_2 = Multiplication(A=item_35, B=0.001)

# ---- group: Hooneosade andmed / Trepikodade arv
mindex_35 = MemberIndex(Set=trim_3, Member="sissepaasuKorrus")  # -> Index, Count
item_37 = ListItem(List=trim_4, Index=mindex_35.Index, Wrap=True)
trim_10 = TrimTree(Tree=item_37, Depth=1)
nullrep_2 = ReplaceNulls(Items=trim_10, Replacements="0")  # -> Items, Count
bnd = Bounds(Numbers=nullrep_2.Items)
dedomain = DeconstructDomain(Domain=bnd)  # -> Start, End
num = Number(dedomain.End)
division = Division(A=num, B="2")
round = Round(Number=division)  # -> Nearest, Floor, Ceiling
equals_3 = Equality(FirstNumber=trim_10, SecondNumber=round.Ceiling)  # -> Equality, Inequality
mindex_36 = MemberIndex(Set=equals_3.Equality, Member=Toggle(True))  # -> Index, Count
item_38 = ListItem(List=rjv_5.AsString, Index=mindex_36.Index, Wrap=True)
sort = SortList(Keys=item_38)  # -> Keys, ValuesA
shift = ShiftList(List=sort.Keys, Shift=1, Wrap=True)
lng_3 = ListLength(List=shift)
lng_4 = ListLength(List=sort.Keys)
subtraction = Subtraction(A=lng_3, B="1")
subtraction_2 = Subtraction(A=lng_4, B="1")
cull_i_2 = CullIndex(List=sort.Keys, Indices=subtraction_2, Wrap=True)
cull_i_3 = CullIndex(List=shift, Indices=subtraction, Wrap=True)
subtraction_3 = Subtraction(A=cull_i_3, B=cull_i_2)
larger = LargerThan(FirstNumber=subtraction_3, SecondNumber="1")  # -> LargerThan, OrEqualTo
mindex_37 = MemberIndex(Set=larger.LargerThan, Member=Toggle(True))  # -> Index, Count
lng_5 = ListLength(List=mindex_37.Index)
addition_5 = Addition(A="1", B=lng_5)
trim_11 = TrimTree(Tree=addition_5, Depth="3")
equals_4 = Equality(FirstNumber=trim_11, SecondNumber="0")  # -> Equality, Inequality
mindex_38 = MemberIndex(Set=equals_4.Equality, Member=Toggle(True))  # -> Index, Count
replace = ReplaceItems(List=trim_11, Indices=mindex_38.Index, Wrap=False)
trim_12 = TrimTree(Tree=replace, Depth="2")
nullrep_3 = ReplaceNulls(Items=trim_12, Replacements="1")  # -> Items, Count

# ----
dejsonkv_7 = DeserializeKeysAndValues(JSON=dejson_2.EhitisePohiandmed, Keys="maxKorrusteArv")  # -> Key, Value
dejsonkv_8 = DeserializeKeysAndValues(JSON=dejson_2.EhitisePohiandmed, Keys="minKorrusteArv")  # -> Key, Value
dejsonkv_9 = DeserializeKeysAndValues(JSON=dejson_2.EhitisePohiandmed, Keys="ehitisalunePind")  # -> Key, Value
dejsonkv_10 = DeserializeKeysAndValues(JSON=dejson_2.EhitisePohiandmed, Keys="suletud_netopind")  # -> Key, Value
dejsonkv_11 = DeserializeKeysAndValues(JSON=dejson_2.EhitisePohiandmed, Keys="maaalusteKorrusteArv")  # -> Key, Value
dejsonkv_12 = DeserializeKeysAndValues(JSON=dejson_2.EhitisePohiandmed, Keys="lift")  # -> Key, Value
int = Integer(dejsonkv_12.Value)
num_2 = Number(dejsonkv_10.Value)
int_2 = Integer(dejsonkv_7.Value)
int_3 = Integer(dejsonkv_11.Value)
int_4 = Integer(dejsonkv_8.Value)
num_3 = Number(dejsonkv_9.Value)
kuna_on_nii_miinuse_kui_plussiga_väärtus = Absolute(Value=int_3)  # "Kuna on nii miinuse kui plussiga väärtusi"
suirify_2 = Suirify(int)
larger_2 = LargerThan(FirstNumber=int_2, SecondNumber="5")  # -> LargerThan, OrEqualTo
addition_6 = Addition(A=int_2, B=kuna_on_nii_miinuse_kui_plussiga_väärtus)
mindex_39 = MemberIndex(Set=larger_2.LargerThan, Member=Toggle(True))  # -> flatten(Index), Count

# ---- group: Hooneosade andmed / Trepikodade arv (continued)
larger_3 = LargerThan(FirstNumber=suirify_2, SecondNumber="0")  # -> LargerThan, OrEqualTo
mindex_40 = MemberIndex(Set=larger_3.LargerThan, Member=Toggle(True))  # -> Index, Count
suirify_3 = Suirify(mindex_40.Index)
replace_2 = ReplaceItems(List=nullrep_3.Items, Item=suirify_2, Indices=suirify_3, Wrap=False)
suirify_4 = Suirify(replace_2)

# ---- group: Hooneosade andmed / Trepikodade arve geomeetriast
equals_5 = Equality(SecondNumber=suirify_4)  # -> Equality, Inequality
mindex_41 = MemberIndex(Set=equals_5.Equality, Member=Toggle(False))  # -> Index, Count
suirify_5 = Suirify(mindex_41.Index)
replace_3 = ReplaceItems(List=suirify_4, Indices=suirify_5, Wrap=False)

# ----
replace_4 = ReplaceItems(List=suirify_2, Item=suirify_4, Indices=mindex_39.Index, Wrap=False)

panel_18 = Panel(num_2)

# ---- group: JSONst geomeetria loomine
dejson_26 = DeserializeJson(JSON=dejson_22.Particles, OutputsLocked=False)  # -> Area, X0, Y0, Z0, X1, Y1, Z1, X2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
pt_3 = ConstructPoint(XCoordinate=dejson_26.X0, YCoordinate=dejson_26.Y0, ZCoordinate=dejson_26.Z0)  # -> graft(Point)
pt_4 = ConstructPoint(XCoordinate=dejson_26.X1, YCoordinate=dejson_26.Y1, ZCoordinate=dejson_26.Z1)  # -> graft(Point)
pt_5 = ConstructPoint(XCoordinate=dejson_26.X2, YCoordinate=dejson_26.Y2, ZCoordinate=dejson_26.Z2)  # -> graft(Point)
merge = Merge(Data1=pt_3, Data2=pt_4, Data3=pt_5)
pline_2 = PolyLine(Vertices=merge, Closed=True)
boundary = BoundarySurfaces(Edges=pline_2)
trim_13 = TrimTree(Tree=boundary, Depth=1)

# ---- group: Suhtelise nulli vektor / Suhtelise nulli Z vektor
merge_2 = Merge(Data1=dejson_26.Z0, Data2=dejson_26.Z1, Data3=dejson_26.Z2)
bnd_2 = Bounds(Numbers=merge_2)
dedomain_2 = DeconstructDomain(Domain=bnd_2)  # -> Start, End
pt_6 = ConstructPoint(XCoordinate=0, YCoordinate=0, ZCoordinate=dedomain_2.Start)
multiplication_3 = Multiplication(A=pt_6, B="-1")

# ---- group: Suhtelise nulli vektor
addition_7 = Addition(A=multiplication_3, B=multiplication)

# ---- group: JSONst geomeetria loomine (continued)
move_3 = Move(Geometry=trim_13, Motion=addition_7)  # -> Geometry, Transform
suirify_6 = Suirify(move_3.Geometry)
clean = CleanTree(RemoveNulls=True, RemoveInvalid=True, RemoveEmpty=True, Tree=suirify_6)
mesh = MeshBrep(
    Brep=clean,
    Settings={GridMaxCount=0, GridMinCount=16, JaggedSeams=False, MaxEdgeLength=0, MinEdgeLength=0.0001, MinTolerance=0, Refine=True, RefineAngle=0, RelativeTolerance=0.65, SimplePlanes=True, Tolerance=0})
mcol_8 = MeshColours(Mesh=flatten(mesh), Colours=ColourSwatch(SwatchColor=RGBA(33, 58, 204, 164)))

# ----
mjoin_8 = MeshJoin(Meshes=mesh)
filter_2 = StreamFilter(Gate=bool, Stream0=mcol_8)
context_bake_8 = ContextBake(Geometry=filter_2)
